# Dynamo graph Fire_Rated_Wall_Penetrations.dyn (Dynamo 2.0.3.8810)

# group: Calculations / Data Processing (Dynamo)
# note: Calculations / Data Processing

# group: Creating / Manipulating Elements in Revit
# note: Creating Elements in Revit.

# group: Writing Data, to Revit, Excel, Etc.
# note: Writing to Revit, Excel, Etc.

# group: Reading Data from Revit, Excel, Etc.
# note: Reading Data from Revit, Excel, Etc.

# group: User Inputs
# note: User Inputs: Blue

# group: User Notes: Revit/Parameter Prerequisites/ Authorship
# note: Required Add-In Packages:
# [none]
# note: Required Custom Parameters in Revit:
# [none]
# note: Author: Guy Mazzotta, PE, SE (CA)
# Title: Director of Technology / Structural Engineer
# Date: 07.21.2020
# Shirk & O'Donovan
# guymazzotta@shirkodonovan.com

# group: Select All Walls
categories = Categories(index=604)
all_elements_of_category = ElementsOfCategory(Category=categories)

switch = CodeBlock(pass_through=all_elements_of_category)
# ---------- switch.designscript (2 lines) ----------
pass_through;
//this is a switch to turn node on and off
# ----------------------------------------

# group: Extract Wall Fire Rating
string = StringInput("Type")
getParameterValueByName = Element.GetParameterValueByName(element=switch, parameterName=string)
string_2 = StringInput("Fire Rating")
getParameterValueByName_2 = Element.GetParameterValueByName(element=getParameterValueByName, parameterName=string_2)

# group: Input Fire Rating
string_3 = StringInput("2")

# group: Filters Walls to Find Walls with Rating Specified and Those Without
eq = getParameterValueByName_2 == string_3
filterByBoolMask = List.FilterByBoolMask(list=switch, mask=eq)

# group: Resets all non-rated wall overrides in view
byProperties = Revit.Filter.OverrideGraphicSettings.ByProperties()
overrideInView = Element.OverrideInView(element=filterByBoolMask.out, overrides=byProperties)

# group: Input Component to Check Against Rated Walls...(i.e. does this component go through a rated wall?)
categories_2 = Categories(index=180)

# group: Select All Elements of Category
all_elements_of_category_2 = ElementsOfCategory(Category=categories_2)

switch_2 = CodeBlock(pass_through=all_elements_of_category_2)  # same code as switch

# group: Extract Revit Geometry for Rated Walls into Dynamo
geometry = Element.Geometry(element=filterByBoolMask.in)
flatten = List.Flatten(list=geometry)
geometry_2 = Element.Geometry(element=switch_2)
flatten_2 = List.Flatten(list=geometry_2)

# group: Using Python to find rated walls that have penetration from specified component.
code_block = CodeBlock(in0=flatten, in1=flatten_2)
# ---------- code_block.designscript (4 lines) ----------
in0;
//wall geometry;
in1;
//pipe/duct/clash sytem;
# ----------------------------------------
python_mep_systems_intersect = Python(IN[0]=code_block.in0, IN[1]=code_block.in1)  # "Python - MEP Systems Intersect Fire Rated Walls"
# ---------- python_mep_systems_intersect.python (29 lines) ----------
#Guy Mazzotta
#07/17/2020
#Shirk and O'Donovan Structural Engineers
#guymazzotta@shirkodonovan.com

#Input walls and ceiling lists of different size.
#Finds associated walls for ceiling.


import clr
clr.AddReference('ProtoGeometry')
from Autodesk.DesignScript.Geometry import *

#The inputs to this node will be stored as a list in the IN variables.

Walls = IN [0] #input list of walls
Ceilings = IN [1] # input list of ceilings

List_Filtered = [0]*len(Walls) #allocate space for return list

for i in range(len(Walls)):
	List_Filtered[i] = False 
	for j in range(len(Ceilings)):
		if Walls[i].DoesIntersect(Ceilings[j]): #check if wall intersects any ceiling
			List_Filtered[i]=Walls[i].DoesIntersect(Ceilings[j])


#Assign your output to the OUT variable.
OUT = List_Filtered
# ----------------------------------------

# group: Filter rated walls with (in) from those without penetrations (out)
filterByBoolMask_2 = List.FilterByBoolMask(list=filterByBoolMask.in, mask=python_mep_systems_intersect)

# group: Resets all rated walls overrides if there are not any penetrations
byProperties_2 = Revit.Filter.OverrideGraphicSettings.ByProperties()
overrideInView_2 = Element.OverrideInView(element=filterByBoolMask_2.out, overrides=byProperties_2)

# group: Warning Color
color_palette = ColorPalette({R: 220, G: 20, B: 60, A: 255})

# group: Sets all rated walls with penetrations to a given color
overrideColorInView = Element.OverrideColorInView(element=filterByBoolMask_2.in, color=color_palette)
