# Dynamo graph CenterRoomByView.dyn (Dynamo 2.0.3.8810)

# group: CUSTOM
# note: USE:
# CUSTOM NODES

# group: OUTPUT
# note: USE:
# ALL DATA OUTPUT

# group: DATA
# note: USE:
# ALL MAIN DATA PROCESSES

# group: INPUT
# note: USE:
# FOR THE INCOMMING REFFERENCES
# FILE PATHS, GEOMETRIES .......

# group: WIP
# note: USE:
# FOR WORK IN PROGRESS

# group: Script Info
# note: Packages used in this script:
# 	archi-lab.net version: 2020.22.7
# 	Rhythm version: 2019.12.4
notes = CodeBlock()
# ---------- notes.designscript (3 lines) ----------
// Created by Joshuajhostetler@gmail.com
//Created with Dynamo 2.04
//
# ----------------------------------------

# group: Identify Current view and Rooms
categories = Categories(index=425)
current = Document.Current()
activeView = Document.ActiveView(document=current)

# group: Select all Rooms in View
byCategoryAndView = archilab.Revit.Selection.Select.ByCategoryAndView(category=categories, view=activeView)

# group: Center Rooms
ʳʰʸᵗʰᵐ_rooms_centerroom = Rhythm.Revit.Elements.Rooms.CenterRoom(room=byCategoryAndView)

# group: Grab All Rooms
categories_2 = Categories(index=425)  # frozen
all_elements_of_category = ElementsOfCategory(Category=categories_2)

# group: Center Rooms
ʳʰʸᵗʰᵐ_rooms_centerroom_2 = Rhythm.Revit.Elements.Rooms.CenterRoom(room=all_elements_of_category)
