# Dynamo graph Change All Phase.dyn "SHYFT_Change All Phase" (Dynamo 2.0.3.8810)

# group: Select all elements in 3D view
# note: Script Name: SHYFT_Change All Phase.dyn
# Created by: kevinsullivan36@gmail.com
# Packages used in this script:
# n/a
select_model_elements = DSModelElementsSelection()  # 127 picked in the model

# group: Select Phase Parameter to change
code_block = CodeBlock { "Phase Created"; }
select_phase = RevitPhases(index=0)

# group: Changes all elements phase to selected phase. (will show error for items without phase)
setParameterByName = Element.SetParameterByName(element=select_model_elements, parameterName=code_block, value=select_phase)

watch = Watch(select_model_elements)
