# Dynamo graph Color by Warnings.dyn (Dynamo 2.0.3.8810)

# group: CUSTOM
# note: USE:
# CUSTOM NODES

# group: OUTPUT
# note: USE:
# ALL DATA OUTPUT

# group: DATA
# note: USE:
# ALL MAIN DATA PROCESSES

# group: INPUT
# note: USE:
# FOR THE INCOMMING REFFERENCES
# FILE PATHS, GEOMETRIES .......

# group: WIP
# note: USE:
# FOR WORK IN PROGRESS

# group: SCRIPT INFO
# note: Packages used in this script:
# 	Bang 2019.3.1
notes = CodeBlock()
# ---------- notes.designscript (3 lines) ----------
// Created by Joshuajhostetler@gmail.com
//Created with Dynamo 2.04
//
# ----------------------------------------

# group: Grab all Warnings and Choose Color
boolean = BoolSelector(true)
getWarnings = Bang.Revit.Elements.WarningTools.GetWarnings(toggle=boolean)
color_palette = ColorPalette({R: 255, G: 0, B: 0, A: 255})

# group: Override Color
overrideColorInView = Element.OverrideColorInView(element=getWarnings.Failing_Elements, color=color_palette)

# group: Choose Warning
all_warnings_of_type = WarningsOfType(index=1)  # frozen

# group: Grab elements involded and choose color
failingElements = Bang.Revit.Elements.Warning.FailingElements(warning=all_warnings_of_type)
color_palette_2 = ColorPalette({R: 255, G: 0, B: 0, A: 255})

# group: Override Color
overrideColorInView_2 = Element.OverrideColorInView(element=failingElements, color=color_palette_2)
