# Dynamo graph Duplicate Sheets.dyn "SHYFT - Duplicate Sheets" (Dynamo 2.0.3.8810)

# group: Select Sheet
# note: Script Name: SHYFT - Duplicate Sheets.dyn
# Created by: kevinsullivan36@gmail.com
# Packages used in this script:
# bimorphNodes version: 3.0.3
views = Views(index=8)

# group: Control Inputs
# note: T/F - Controls running duplicate node
boolean = BoolSelector(true)
# note: T/F - Controls duplicating on sheet views
boolean_2 = BoolSelector(true)
code_block = CodeBlock { 1; }
# note: Control for view duplicate options:
# 0 - Duplicate
# 1 - With Detailing
# 2 - As Dependent
# note: Add name in ".." for placeholder suffix name
code_block_2 = CodeBlock { "Duplicate Name"; }

# group: Bimorph node
duplicate = Revit.Sheet.Duplicate(sheets=views, run=boolean, duplicateWithViews=boolean_2, duplicateOption=code_block, suffix=code_block_2)

watch = Watch(duplicate.report)
watch_2 = Watch(duplicate.Sheet)
