# Dynamo graph Room Number_Door Name.dyn (Dynamo 2.0.3.8810)

# group: CUSTOM
# note: USE:
# CUSTOM NODES

# group: OUTPUT
# note: USE:
# ALL DATA OUTPUT

# group: DATA
# note: USE:
# ALL MAIN DATA PROCESSES

# group: INPUT
# note: USE:
# FOR THE INCOMMING REFFERENCES
# FILE PATHS, GEOMETRIES .......

# group: WIP
# note: USE:
# FOR WORK IN PROGRESS

# group: Script Info
# note: Packages used in this script:
# 	Clockwork for Dynamo 0.9.x version: 0.90.8
# 	Clockwork for Dynamo 1.x version: 1.31.1
# 	Clockwork for Dynamo 2.x version: 2.1.2
notes = CodeBlock()
# ---------- notes.designscript (3 lines) ----------
// Created by Joshuajhostetler@gmail.com
//Created with Dynamo 2.4
//
# ----------------------------------------

# group: Grab all Doors on New Construction
categories = Categories(index=159)
all_elements_of_category = ElementsOfCategory(Category=categories)
select_phase = RevitPhases(index=1)

# group: Search the Room the Door Swings in to and grab Room #
rooms = Custom[Door.Rooms](door=all_elements_of_category, phase=select_phase)  # frozen; Gets the rooms that are connected by a given door
number = Room.Number(room=rooms.toRoom)

# group: Set Room Number as Door Mark
code_block = CodeBlock { "Mark"; }
setParameterByName = Element.SetParameterByName(element=all_elements_of_category, parameterName=code_block, value=number)

watch = Watch(number)
watch_2 = Watch(all_elements_of_category)
