# Dynamo graph Text to upper.dyn "SHYFT - Text to upper" (Dynamo 2.0.3.8810)

# group: Collect text notes in view
# note: Script Name: SHYFT - Text to upper.dyn
# Created by: kevinsullivan36@gmail.com
# Packages used in this script:
# Springs
element_types = ElementTypes(index=319)
ꟿ_collect_allelementsof = Custom[ꟿ Collect.AllElementsOf](CategoryOrType=element_types)  # Works with either categories or types and uses multi-filters to get multiple groups with a single query. Can be applied as a function. No ties to the Document.Changed event.

# group: Change all text notes to uppercase
text = TextNote.Text(textNote=ꟿ_collect_allelementsof)
toUpper = String.ToUpper(str=text)
setText = TextNote.SetText(textNote=ꟿ_collect_allelementsof, value=toUpper)
