# Dynamo graph Wall_Above_Ceiling.dyn (Dynamo 2.0.3.8810)

# group: Calculations / Data Processing (Dynamo)
# note: Calculations / Data Processing

# group: Creating / Manipulating Elements in Revit
# note: Creating Elements in Revit.

# group: Writing Data, to Revit, Excel, Etc.
# note: Writing to Revit, Excel, Etc.

# group: Reading Data from Revit, Excel, Etc.
# note: Reading Data from Revit, Excel, Etc.

# group: User Inputs
# note: User Inputs: Blue

# group: User Notes: Revit/Parameter Prerequisites/ Authorship
# note: Required Add-In Packages:
# [none]
# note: Author: Guy Mazzotta, PE, SE (CA)
# Title: Director of Technology / Structural Engineer
# Date: 07.21.2020
# Shirk & O'Donovan
# guymazzotta@shirkodonovan.com
# note: Required Parameters in Revit:
# [none]

# group: Select All Walls Components from Revit
categories = Categories(index=604)
all_elements_of_category = ElementsOfCategory(Category=categories)

switch = CodeBlock(pass_through=all_elements_of_category)
# ---------- switch.designscript (2 lines) ----------
pass_through;
//this is a switch to turn node on and off
# ----------------------------------------

# group: Tolerance for Checking for Intersection
number = DoubleInput(2)

# group: Extrudes Wall Geometries to Check for Intersection with Ceilings
faces = Element.Faces(element=switch)
offset = Surface.Offset(surface=faces, distance=number)
byJoinedSurfaces = PolySurface.ByJoinedSurfaces(surfaces=offset)
flatten = List.Flatten(list=byJoinedSurfaces)

# group: Select All Ceilings
categories_2 = Categories(index=110)
all_elements_of_category_2 = ElementsOfCategory(Category=categories_2)

# group: Extrudes Ceiling Geometries to Check for Intersection with Walls
faces_2 = Element.Faces(element=all_elements_of_category_2)
offset_2 = Surface.Offset(surface=faces_2, distance=number)
byJoinedSurfaces_2 = PolySurface.ByJoinedSurfaces(surfaces=offset_2)
flatten_2 = List.Flatten(list=byJoinedSurfaces_2)

# group: Read Wall Parameters from Revit
string = StringInput("Unconnected Height")
getParameterValueByName = Element.GetParameterValueByName(element=switch, parameterName=string)
string_2 = StringInput("Base Constraint")
getParameterValueByName_2 = Element.GetParameterValueByName(element=switch, parameterName=string_2)
elevation = Level.Elevation(level=getParameterValueByName_2)
string_3 = StringInput("Base Offset")
getParameterValueByName_3 = Element.GetParameterValueByName(element=switch, parameterName=string_3)

# group: Calculates Top of Wall Elevations
b_wall_elevation = elevation + getParameterValueByName_3
t_wall_elevation = getParameterValueByName + b_wall_elevation
flatten_3 = List.Flatten(list=t_wall_elevation)

# group: Read ceiling parameters from Revit
string_4 = StringInput("Height Offset From Level")
getParameterValueByName_4 = Element.GetParameterValueByName(element=all_elements_of_category_2, parameterName=string_4)
string_5 = StringInput("Level")
getParameterValueByName_5 = Element.GetParameterValueByName(element=all_elements_of_category_2, parameterName=string_5)

# group: Calculate Ceiling Elevations
elevation_2 = Level.Elevation(level=getParameterValueByName_5)
add = getParameterValueByName_4 + elevation_2
flatten_4 = List.Flatten(list=add)

# group: Min. distance from Ceiling to T/ Wall
number_2 = DoubleInput(0.5)

# group: Python Graph to Find: 1. Whether Wall Intersects Ceilings 1a. If so, flag whether T/Wall is above ceiling by minimum distance.
code_block = CodeBlock(in0=flatten, in1=flatten_2, in2=flatten_3, in3=flatten_4, in4=number_2)
# ---------- code_block.designscript (11 lines) ----------
in0;
//wall geometry as polysurface;
in1;
//ceiling as polysurface;
in2;
//top of wall elevation;
in3;
//ceiling elevations;
in4;
//tolerance (min dist from t/wall to
//ceiling)
# ----------------------------------------
python_walls_intersect_ceiling = Python(IN[0]=code_block.in0, IN[1]=code_block.in1, IN[2]=code_block.in2, IN[3]=code_block.in3, IN[4]=code_block.in4)
# ---------- python_walls_intersect_ceiling.python (32 lines) ----------
#Guy Mazzotta
#07/17/2020
#Shirk and O'Donovan Structural Engineers
#guymazzotta@shirkodonovan.com

#Input Wall_Geom and ceiling lists of different size.
#Finds associated Wall_Geom for ceiling.


import clr
clr.AddReference('ProtoGeometry')
from Autodesk.DesignScript.Geometry import *

#The inputs to this node will be stored as a list in the IN variables.

Wall_Geom = IN [0] #input list of Wall_Geom
CLG_as_PolySurface = IN [1] # input list of CLG_as_PolySurface
Top_Wall_Elevation = IN [2] #input top of wall elevation
CLG_Elevation = IN [3] #input ceiling elevation
Tolerance = IN [4] #input tolerance for distance from ceiling to top of wall

List_Filtered = [0]*len(Wall_Geom) #allocate space for return list that will indicate which walls are above #ceiling by more than Tolerance
#True = Above Wall Tolerance OK ; False = Wall is not above ceiling tolerance.

for i in range(len(Wall_Geom)):
	List_Filtered[i] = True 
	for j in range(len(CLG_as_PolySurface)):
		if Wall_Geom[i].DoesIntersect(CLG_as_PolySurface[j]): #check if wall intersects any ceiling
			if (Top_Wall_Elevation[i] - CLG_Elevation[j]) < Tolerance: #check if top of wall is less than #tolerance above ceiling
				List_Filtered[i] = False #wall does not extend above ceiling more than tolerance
#Assign your output to the OUT variable.
OUT = List_Filtered
# ----------------------------------------
watch = Watch(python_walls_intersect_ceiling)
filterByBoolMask = List.FilterByBoolMask(list=switch, mask=watch)

# group: Sets Wall Graphics to Red for Walls that are not above Ceiling by tolerance specified.
color_palette = ColorPalette({R: 255, G: 0, B: 0, A: 255})
overrideColorInView = Element.OverrideColorInView(element=filterByBoolMask.out, color=color_palette)

# group: Reset Graphic Overrides for Walls that are OK.
byProperties = Revit.Filter.OverrideGraphicSettings.ByProperties()
overrideInView = Element.OverrideInView(element=filterByBoolMask.in, overrides=byProperties)
