# Dynamo graph Batch Create Revit Sheets.dyn (Dynamo 2.0.3.8810)

# group: CUSTOM
# note: USE:
# CUSTOM NODES

# group: OUTPUT
# note: USE:
# ALL DATA OUTPUT

# group: DATA
# note: USE:
# ALL MAIN DATA PROCESSES

# group: INPUT
# note: USE:
# FOR THE INCOMMING REFFERENCES
# FILE PATHS, GEOMETRIES .......

# group: WIP
# note: USE:
# FOR WORK IN PROGRESS

# group: Script Info
# note: Packages used in this script:
# 	None
notes = CodeBlock()
# ---------- notes.designscript (3 lines) ----------
// Modified by Joshuajhostetler@gmail.com
//Created with Dynamo 2.4
//
# ----------------------------------------

# group: Select Excel file
file_path = Filename("..\Test Sheets.xlsx")
file_from_path = FileObject(path=file_path)
string = StringInput("Sheet1")

# group: Extract Data From Excel
importExcel = Data.ImportExcel(file=file_from_path, sheetName=string)  # frozen
transpose = List.Transpose(lists=importExcel)

# group: Sheet Name
number = DoubleInput(1)
getItemAtIndex = List.GetItemAtIndex(list=transpose, index=number)

# group: Sheet Number
number_2 = DoubleInput(0)
getItemAtIndex_2 = List.GetItemAtIndex(list=transpose, index=number_2)

# group: Create Sheets
family_types = FamilyTypes()  # nothing selected
byNameNumberTitleBlockAndViews = Sheet.ByNameNumberTitleBlockAndViews(sheetName=getItemAtIndex, sheetNumber=getItemAtIndex_2, titleBlockFamilyType=family_types)  # unwired: views

# group: Temp View to complete Script
levels = Levels(index=0)
byLevel = FloorPlanView.ByLevel(level=levels)

watch = Watch()  # unwired: arg0
