# Dynamo graph Door - Wall Type Host.dyn (Dynamo 2.3.0.5885)
# packages: archi-lab.net 2020.22.7

# group: CUSTOM
# note: USE:
# CUSTOM NODES

# group: OUTPUT
# note: USE:
# ALL DATA OUTPUT

# group: DATA
# note: USE:
# ALL MAIN DATA PROCESSES

# group: INPUT
# note: USE:
# FOR THE INCOMMING REFFERENCES
# FILE PATHS, GEOMETRIES .......

# group: WIP
# note: USE:
# FOR WORK IN PROGRESS

# group: Select All Doors
categories = Categories("OST_Doors")
all_elements_of_category = ElementsOfCategory(Category=categories)

# group: Select Host of each door and grab Type Mark and Width
get_host_element = Custom[Get Host Element](hostedElement=all_elements_of_category)  # package archi-lab.net; This node will retrieve a host element from hosted element. Ex. feed in door, get wall.
name = Element.Name(element=get_host_element)
byName = WallType.ByName(name=name)
string = StringInput("Type Mark")
getParameterValueByName = Element.GetParameterValueByName(element=byName, parameterName=string)
string_2 = StringInput("Width")
getParameterValueByName_2 = Element.GetParameterValueByName(element=byName, parameterName=string_2)

# group: Set Custom Door Parameters
# note: This is a Project Parameter
string_3 = StringInput("Wall Type")
setParameterByName = Element.SetParameterByName(element=all_elements_of_category, parameterName=string_3, value=getParameterValueByName)
string_4 = StringInput("Wall Host Width")
setParameterByName_2 = Element.SetParameterByName(element=all_elements_of_category, parameterName=string_4, value=getParameterValueByName_2)

# group: Script Info
# note: Packages used in this script:
# archi-lab.net version: 2020.22.7
notes = CodeBlock()
# ---------- notes.designscript (3 lines) ----------
// Created by Joshuajhostetler@gmail.com
//Created with Dynamo 2.3
//
# ----------------------------------------
