# Dynamo graph SOCE_Add_Revisions_Multi_Sheet.dyn (Dynamo 2.3.0.5885)
# packages: Data-Shapes 2021.2.91, archi-lab.net 2016.12.7

# group: Writing Data, to Revit, Excel, Etc.
# note: Writing to Revit, Excel, Etc.

# group: Creating / Manipulating Elements in Revit
# note: Creating Elements in Revit.

# group: Calculations / Data Processing (Dynamo)
# note: Calculations / Data Processing

# group: Reading Data from Revit, Excel, Etc.
# note: Reading Data from Revit, Excel, Etc.

# group: User Inputs
# note: User Inputs: Blue

# group: Prompt User For Revision to Add to Each Sheet
boolean = BoolSelector(true)
archi_lab_grimshaw_get_all = Custom[Archi-lab_Grimshaw_Get All Revisions](RunIt=boolean)  # package archi-lab.net; This node will return all Revisions currently defined in the mode.
archi_lab_grimshaw_revision = Custom[Archi-lab_Grimshaw_Revision Properties](Revisions=archi_lab_grimshaw_get_all)  # package archi-lab.net; This node will return some most common Revision properties like Description or Issue Date.
watch = Watch(archi_lab_grimshaw_revision.Description)
code_block = CodeBlock { "Revisions"; }
data_shapes_listview_data = Custom[Data-Shapes_Listview Data](InputName=code_block, Keys=archi_lab_grimshaw_revision.Description, Values=archi_lab_grimshaw_get_all)  # package Data-Shapes; Create data for ListView input in UI.MultiInputForm ++ . Check out www.data-shapes.net for more infos.

# group: Prompt User for Sheets Requiring a Revision Mark
code_block_2 = CodeBlock { "Sheets"; }
code_block_3 = CodeBlock { "Sheets"; }
byName = Category.ByName(name=code_block_3)
all_elements_of_category = ElementsOfCategory(Category=byName)
code_block_4 = CodeBlock { "Sheet Number"; }
getParameterValueByName = Element.GetParameterValueByName(element=all_elements_of_category, parameterName=code_block_4)
code_block_5 = CodeBlock { " - "; }
operators = getParameterValueByName + code_block_5
code_block_6 = CodeBlock { "Sheet Name"; }
getParameterValueByName_2 = Element.GetParameterValueByName(element=all_elements_of_category, parameterName=code_block_6)
operators_2 = operators + getParameterValueByName_2
data_shapes_listview_data_2 = Custom[Data-Shapes_Listview Data](InputName=code_block_2, Keys=operators_2, Values=all_elements_of_category)

# group: Dialog Box Prompt for Sheet and Revisions
code_block_7 = CodeBlock { "Add Revisions to Multiple Sheets"; }
code_block_8 = CodeBlock { "Add Revisions"; }
list_create = List.Create(item0=data_shapes_listview_data_2, item1=data_shapes_listview_data)
boolean_2 = BoolSelector(true)
data_shapes_multipleinputform = Custom[Data-Shapes_MultipleInputForm ++](Description_optional=code_block_7, ButtonText_optional=code_block_8, Inputs=list_create, Toggle=boolean_2)  # package Data-Shapes; Create a form with multiple inputs. see www.data-shapes.net for tutorials and infos!

watch_2 = Watch(data_shapes_multipleinputform.User_Inputs)

# group: Write Input Revisions to Sheets in Revit; Index 0 = Sheet Name Index 1 = Revision Per Sheet Name
code_block_9 = CodeBlock { 0; }
getItemAtIndex = List.GetItemAtIndex(list=watch_2, index=code_block_9)
code_block_10 = CodeBlock { 1; }
getItemAtIndex_2 = List.GetItemAtIndex(list=watch_2, index=code_block_10)
code_block_11 = CodeBlock { true; }
archi_lab_grimshaw_add_revisions = Custom[Archi-lab_Grimshaw_Add Revisions to Sheet](Sheet=getItemAtIndex, Revisions=getItemAtIndex_2, RunIt=code_block_11)  # package archi-lab.net; This node will add specified revisions to a sheet.

# group: User Notes: Revit/Parameter Prerequisites/ Authorship
authorship___dynamo_version = CodeBlock()
# ---------- authorship___dynamo_version.designscript (7 lines) ----------
//Author: Guy Mazzotta, PE SE (CA)
//Director of Technology
//Shirk & O'Donovan
//Date: 12.29.2020
//email: guymazzotta@shirkodonovan.com
//Description of Graph: Adds revisions to multiple sheets
//Dynamo_Version: v2.3
# ----------------------------------------
