# Dynamo graph SOCE_Revision_Log.dyn (Dynamo 2.3.0.5885)
# packages: archi-lab.net 2016.12.7, Data-Shapes 2021.2.91

# group: Writing Data, to Revit, Excel, Etc.
# note: Writing to Revit, Excel, Etc.

# group: Creating / Manipulating Elements in Revit
# note: Creating Elements in Revit.

# group: Calculations / Data Processing (Dynamo)
# note: Calculations / Data Processing

# group: Reading Data from Revit, Excel, Etc.
# note: Reading Data from Revit, Excel, Etc.

# group: User Inputs
# note: User Inputs: Blue

code_block = CodeBlock { "File Path"; }

# group: Input Excel Sheet for Exporting Revision Logs
code_block_2 = CodeBlock { "Select Excel Spreadsheet for Revision Log"; }
code_block_3 = CodeBlock { "RUN"; }
code_block_4 = CodeBlock { "Excel Revision Log"; }
filepath_data = Custom[FilePath Data](InputName=code_block_4, ButtonText=code_block)  # package Data-Shapes; Create filepath input for UI.MultipleInputForm ++ . Check out www.data-shapes.net for more infos !
boolean = BoolSelector(true)
multipleinputform = Custom[MultipleInputForm ++](Description_optional=code_block_2, ButtonText_optional=code_block_3, Inputs=filepath_data, Toggle=boolean)  # package Data-Shapes; Create a form with multiple inputs. see www.data-shapes.net for tutorials and infos!

switch = Watch(multipleinputform.User_Inputs)

# group: Name of Sheet for Rev_Log
code_block_5 = CodeBlock()
# ---------- code_block_5.designscript (2 lines) ----------
"Revision_Log";
 //will create sheet if not found.;
# ----------------------------------------

# group: Reads Sheet Category
code_block_6 = CodeBlock { "Sheets"; }
byName = Category.ByName(name=code_block_6)

all_elements_of_category = ElementsOfCategory(Category=byName)

# group: Extract Revision Information from Revit
revisions = Archilab.Grimshaw.Views.Sheet.Revisions(sheet=all_elements_of_category)
revision_properties = Custom[Revision Properties](Revisions=revisions)  # package archi-lab.net; This node will return some most common Revision properties like Description or Issue Date.

# group: Write Revisions Starting in Row 2, Column 2
code_block_7 = CodeBlock { 1; 1; }
exportExcel = Data.ExportExcel(filePath=switch, sheetName=code_block_5, startRow=code_block_7.out0, startCol=code_block_7.out1, data=revision_properties.Description)

# group: Extract Sheet Name and Number
code_block_8 = CodeBlock { "Sheet Number"; }
getParameterValueByName = Element.GetParameterValueByName(element=all_elements_of_category, parameterName=code_block_8)
code_block_9 = CodeBlock { " - "; }
add = getParameterValueByName + code_block_9
code_block_10 = CodeBlock { "Sheet Name"; }
getParameterValueByName_2 = Element.GetParameterValueByName(element=all_elements_of_category, parameterName=code_block_10)
add_2 = add + getParameterValueByName_2
transpose = List.Transpose(lists=add_2)

# group: Write Sheet Name in Column 1
code_block_11 = CodeBlock { 1; 0; }
code_block_12 = CodeBlock { true; }
exportExcel_2 = Data.ExportExcel(filePath=switch, sheetName=code_block_5, startRow=code_block_11.out0, startCol=code_block_11.out1, data=transpose, overWrite=code_block_12)

# group: User Notes: Revit/Parameter Prerequisites/ Authorship
authorship___dynamo_version = CodeBlock()
# ---------- authorship___dynamo_version.designscript (7 lines) ----------
//Author: Guy Mazzotta, PE SE (CA)
//Director of Technology
//Shirk & O'Donovan
//Date: 12.29.2020
//email: guymazzotta@shirkodonovan.com
//Description of Graph: List all revisions in current project
//Dynamo_Version: v2.3
# ----------------------------------------
